# Dynamo custom node Collector.LinkedInstanceElements.dyf (Dynamo 0.8.2.2392)
# category: SpringNodes.Revit.Collectors
# Extract elements by category from the selected linked instances. The transform vector can be used to get the exact location of the elements in the local file

link_instance_s = Input()  # "link instance(s)"
category = Input(category:Category)
refresh = Input(refresh:bool = true)
python_script = Python(IN[0]=link_instance_s, IN[1]=category, IN[2]=refresh)
# ---------- python_script.python (43 lines) ----------
#Copyright(c) 2015, Dimitar Venkov
# @5devene, dimitar.ven@gmail.com
#original design by Julien Benoit, @jbenoit44
# http://aecuandme.wordpress.com/

import clr

import clr
clr.AddReference('ProtoGeometry')
from Autodesk.DesignScript.Geometry import *

clr.AddReference("RevitNodes")
import Revit
clr.ImportExtensions(Revit.Elements)
clr.ImportExtensions(Revit.GeometryConversion)

clr.AddReference("RevitAPI")
import Autodesk
from Autodesk.Revit.DB import FilteredElementCollector, ElementCategoryFilter, XYZ

def tolist(obj1):
	if hasattr(obj1,"__iter__"):
		return obj1
	else:
		return [obj1]

Link1 = UnwrapElement(tolist(IN[0]))
Cat1 = UnwrapElement(IN[1])
elements, transforms = [], []

for l in Link1:
	LinkDoc = l.GetLinkDocument()
	fec = FilteredElementCollector(LinkDoc).OfCategoryId(Cat1.Id).WhereElementIsNotElementType().ToElements()
	fec1 = [e.ToDSType(True) for e in fec]
	elements.append(fec1)
	tf1 = l.GetTransform()
	cs1 = CoordinateSystem.ByOriginVectors(tf1.Origin.ToPoint(True),
	tf1.BasisX.ToVector(True), tf1.BasisY.ToVector(True), tf1.BasisZ.ToVector(True))
	transforms.append(cs1)
if len(elements) == 1:
	OUT = fec1, cs1
else:
	OUT = elements, transforms
# ----------------------------------------
code_block = CodeBlock(res=python_script) { res[0]; res[1]; }
elements = Output(code_block.out0)
transform_s = Output(code_block.out1)  # "transform(s)"
