# Dynamo custom node Dictionary.ByKeysValues.dyf (Dynamo 0.8.2.2392)
# category: SpringNodes.Core
# Dictionaries are an incredibly powerful tool for making associative sets between two equal length lists. The first list must be of unique strings (or numbers) and will be the key and the second list will be the matching values (it can be made up of geometry, elements, even other lists)
# The search keys list will provide the corresponding value to the input key.

keys = Input()
values = Input()
search_keys = Input()
python_script = Python(IN[0]=keys, IN[1]=values, IN[2]=search_keys)
# ---------- python_script.python (24 lines) ----------
#Copyright(c) 2016, Dimitar Venkov
# @5devene, dimitar.ven@gmail.com

import clr

def tolist(obj1):
	if hasattr(obj1,"__iter__"): return obj1
	else: return [obj1]

def output1(l1):
	if len(l1) == 1: return l1[0]
	else: return l1

out1 = []

keys = tolist(IN[0])
elements = tolist(IN[1])
searchVals = tolist(IN[2])
dict1 = dict(zip(keys,elements))
for i in xrange(len(searchVals)):
	try: out1.append(dict1[searchVals[i]])
	except: out1.append([])

OUT = output1(out1)
# ----------------------------------------
result = Output(python_script)
