# Dynamo custom node Geometry.SplitRecursively.dyf (Dynamo 0.8.2.2392)
# category: SpringNodes.Geometry
# Splits a surface or a solid recursively, using the resulting reduced geometry for every next split.

code_block = CodeBlock()
# ---------- code_block.designscript (21 lines) ----------
def splitface1(face:Geometry, planes:var[])
{
return = [Imperative]
{
out1 = {};
for (p in planes)
{
s1 = face.Split(p);
if(Count(s1) < 2)
{
face = s1[0];
continue;
}
face = s1[0];
s2 = s1[1];
out1 = List.AddItemToEnd(s2,out1);
}
out1 = List.AddItemToEnd(face,out1);
return = List.Clean(out1, false);
}
};
# ----------------------------------------
geometry = Input(geometry:Geometry)
tools = Input(tools:var[])
code_block_2 = CodeBlock(face=geometry, planes=tools) { splitface1(face, planes); }
geometry_2 = Output(code_block_2)  # "geometry"
