# Dynamo custom node List.MergeByBoolMask.dyf "Springs.List.MergeByBoolMask" (Dynamo 1.1.0.2094)
# category: Springs.Core.List
# Merge two lists by a boolean mask list. The true count in the mask should be the same as the length of the true list and vice versa for the false list.

mask = Input(mask:var[]..[])
In = Input(In:var[]..[])
Out = Input(Out:var[]..[])
python_script = Python(IN[0]=mask, IN[1]=In, IN[2]=Out)
# ---------- python_script.python (13 lines) ----------
#Copyright(c) 2016, Dimitar Venkov
# @5devene, dimitar.ven@gmail.com

def tolist(obj1):
	if hasattr(obj1,'__iter__'): return obj1
	else: return [obj1]

t1 = tolist(IN[0])
l1 = tolist(IN[1])
l2 = tolist(IN[2])

try: OUT = [l1.pop(0) if i else l2.pop(0) for i in t1]
except: OUT = 'List mismatch.'
# ----------------------------------------
list = Output(python_script)
