# Dynamo custom node Ln2Str.dyf (Dynamo 0.8.1.1942)
# category: SpringNodes.Geometry.Serialization
# Serilize a geometry line to a string for use in Revit parameters

line_s = Input()  # "line(s)"
code_block = CodeBlock(line_s)
# ---------- code_block.designscript (11 lines) ----------
def Pt2Rvt(p1)
{
return = p1.X + "," + p1.Y + "," + p1.Z;
};

def Ln2Rvt(l1)
{
return = Pt2Rvt(l1.StartPoint) + "," + Pt2Rvt(l1.EndPoint);
};

Ln2Rvt(cl);
# ----------------------------------------
string = Output(code_block)
