# Dynamo custom node Number.ToString.dyf "Springs.Number.ToString" (Dynamo 1.0.0.1180)
# category: Springs.Core.String.Actions
# Converts the input number(s) to string. Can process lists.

num = Input(num:var[])
python_script = Python(IN[0]=num)
# ---------- python_script.python (21 lines) ----------
#Copyright(c) 2016, Dimitar Venkov
# @5devene, dimitar.ven@gmail.com

import clr

def tolist(obj1):
	if hasattr(obj1,"__iter__"): return obj1
	else: return [obj1]

def output1(l1):
	if len(l1) == 1: return l1[0]
	else: return l1

num1 = tolist(IN[0])
out1 = []
for i in xrange(len(num1)):
	s1 = str(num1[i])
	if s1[-2:] == ".0": out1.append(s1[:-2])
	else: out1.append(s1)

OUT = output1(out1)
# ----------------------------------------
str = Output(python_script)
