# Dynamo custom node Pt2Str.dyf (Dynamo 0.8.1.1942)
# category: SpringNodes.Geometry.Serialization
# Serilize a geometry point to a string for use in Revit parameters

point_s = Input()  # "point(s)"
code_block = CodeBlock(point_s)
# ---------- code_block.designscript (6 lines) ----------
def Pt2Rvt(p1)
{
return = p1.X + "," + p1.Y + "," + p1.Z;
};

Pt2Rvt(pts);
# ----------------------------------------
string = Output(code_block)
