# Dynamo custom node Sheet.Views+.dyf (Dynamo 0.8.2.2392)
# category: SpringNodes.Revit.Views
# Extracts all views placed on the input sheet(s).  Will be depreciated once the bult in node works with all plan types.

sheet_s = Input()  # "sheet(s)"
python_script = Python(IN[0]=sheet_s)
# ---------- python_script.python (29 lines) ----------
#Copyright(c) 2015, Dimitar Venkov
# @5devene, dimitar.ven@gmail.com

import clr

clr.AddReference("RevitServices")
from RevitServices.Persistence import DocumentManager
doc = DocumentManager.Instance.CurrentDBDocument

clr.AddReference("RevitNodes")
import Revit
clr.ImportExtensions(Revit.Elements)

def tolist(obj1):
	if hasattr(obj1,"__iter__"):
		return obj1
	else:
		return [obj1]

sheets = UnwrapElement(tolist(IN[0]))
sheetviews = []
for s in sheets:
	viewsid = s.GetAllPlacedViews()
	views = [doc.GetElement(v).ToDSType(True) for v in viewsid]
	sheetviews.append(views)
if len(sheetviews) == 1:
	OUT = views
else:
	OUT = sheetviews
# ----------------------------------------
view_s = Output(python_script)  # "view(s)"
